# Grasshopper definition MClightExperiment.gh (Grasshopper 1.0.7)
# plug-ins: Millipede, Weaverbird, Human UI

number_slider = Slider(500, range=0..1000)
construct_domain = ConstructDomain(DomainStart=0, DomainEnd=Slider(1250, range=0..10000))
construct_domain_2 = ConstructDomain(DomainStart=0, DomainEnd=number_slider)
construct_domain_3 = ConstructDomain(DomainStart=0, DomainEnd=number_slider)
md_slider = MDSlider(
    SliderMode=0,
    slider_value=Point(0.4905753954, 0.5908969321, 0.5),
    x_domain=Domain(0, 1),
    y_domain=Domain(0, 1),
    z_domain=Domain(0, 1))
domain_box = DomainBox(Base=PlaneXY(0, 0, 0), X=construct_domain, Y=construct_domain_2, Z=construct_domain_3)
md_slider_2 = MDSlider(
    SliderMode=0,
    slider_value=Point(0.462699518, 0.7148978536, 0.5),
    x_domain=Domain(0, 1),
    y_domain=Domain(0, 1),
    z_domain=Domain(0, 1))
panel = Panel(md_slider)
deconstruct_brep = DeconstructBrep(Brep=domain_box)  # -> Faces, Edges, Vertices
deconstruct = Deconstruct(Point=panel)  # -> XComponent, YComponent, ZComponent
panel_2 = Panel("""1
3""")
deconstruct_2 = Deconstruct(Point=md_slider_2)  # -> XComponent, YComponent, ZComponent
list_item = ListItem(List=deconstruct_brep.Faces, Index=panel_2, Wrap=True)
remap_numbers = RemapNumbers(Value=deconstruct.XComponent, Source=Domain(0, 1), Target=construct_domain)  # -> Mapped, Clipped
remap_numbers_2 = RemapNumbers(Value=deconstruct.YComponent, Source=Domain(0, 1), Target=construct_domain_2)  # -> Mapped, Clipped
area = Area(Geometry=list_item)  # -> Area, Centroid
remap_numbers_3 = RemapNumbers(Value=deconstruct_2.YComponent, Source=Domain(0, 1), Target=construct_domain_2)  # -> Mapped, Clipped
dispatch = Dispatch(List=area.Centroid, DispatchPattern=[True, False])  # -> ListA, ListB
construct_point = ConstructPoint(XCoordinate=remap_numbers.Mapped, YCoordinate=remap_numbers_2.Mapped, ZCoordinate=0)
line = Line(StartPoint=dispatch.ListA, EndPoint=dispatch.ListB)
panel_3 = Panel(construct_point)
construct_point_2 = ConstructPoint(XCoordinate=remap_numbers.Mapped, YCoordinate=remap_numbers_2.Mapped, ZCoordinate=remap_numbers_3.Mapped)
divide_curve = DivideCurve(Curve=line, Count=Slider(5, range=0..10), Kinks=False)  # -> Points, Tangents, Parameters
list_length = ListLength(List=divide_curve.Points)  # -> expr("x-1", Length)
cull_index = CullIndex(List=divide_curve.Points, Indices=flatten([list_length, "0"]), Wrap=True)

# ----
# Map starting point values to
# bounding box domain
#       for XY slider
deconstruct_3 = Deconstruct(Point=simplify(graft(cull_index)))  # -> XComponent, YComponent, ZComponent
remap_numbers_4 = RemapNumbers(Value=deconstruct_3.XComponent, Source=construct_domain, Target=Domain(0, 1))  # -> Mapped, Clipped
remap_numbers_5 = RemapNumbers(Value=deconstruct_3.YComponent, Source=construct_domain_2, Target=Domain(0, 1))  # -> Mapped, Clipped
remap_numbers_6 = RemapNumbers(Value=deconstruct_3.ZComponent, Source=construct_domain_2, Target=Domain(0, 1))  # -> Mapped, Clipped
construct_point_3 = ConstructPoint(XCoordinate=remap_numbers_4.Mapped, YCoordinate=remap_numbers_5.Mapped, ZCoordinate=remap_numbers_6.Mapped)
explode_tree = ExplodeTree(Data=construct_point_3)  # -> Branch0, Branch1, Branch2, Branch3
create_multidimensional_slider = CreateMultidimensionalSlider(StartingValue=explode_tree.Branch0)
create_multidimensional_slider_2 = CreateMultidimensionalSlider(StartingValue=explode_tree.Branch1)
create_multidimensional_slider_3 = CreateMultidimensionalSlider(StartingValue=explode_tree.Branch2)
create_multidimensional_slider_4 = CreateMultidimensionalSlider(StartingValue=explode_tree.Branch3)
merge = Merge(
    Data1=create_multidimensional_slider,
    Data2=create_multidimensional_slider_2,
    Data3=create_multidimensional_slider_3,
    Data4=create_multidimensional_slider_4)  # -> flatten(Result)
list_length_2 = ListLength(List=merge)
partition_list = PartitionList(List=merge, Size=list_length_2)
create_grid = CreateGrid(UIElements=partition_list, ElementRowSpan=1, ElementColumnSpan=1)

# ----
# Z slider
scale = Slider(0, range=0..500)
create_slider = CreateSlider(Slider=scale, ShowBounds=False, ShowTicks=False, ShowTooltip=False, ShowValLabel=True, showLabel=True)
create_slider_2 = CreateSlider(Slider=scale, ShowBounds=False, ShowTicks=False, ShowTooltip=False, ShowValLabel=True, showLabel=True)
create_slider_3 = CreateSlider(Slider=scale, ShowBounds=False, ShowTicks=False, ShowTooltip=False, ShowValLabel=True, showLabel=True)
create_slider_4 = CreateSlider(Slider=scale, ShowBounds=False, ShowTicks=False, ShowTooltip=False, ShowValLabel=True, showLabel=True)
merge_2 = Merge(Data1=create_slider_4, Data2=create_slider, Data3=create_slider_2, Data4=create_slider_3)  # -> graft(Result)

panel_4 = Panel("""Number Slider
Number Slider 1
Number Slider 2
Number Slider 3""")
launch_window = LaunchWindow(Show=True, Name="Control Window", Width=370, Height=400, ChildStatus=0, EnableHorizScroll=False)
add_elements = AddElements(Window=launch_window, Elements=flatten([create_grid, merge_2]), DoVLChecking=True)  # -> AddedElements, ElementNames
value_listener = ValueListener(Elements=add_elements.AddedElements, NameFilterS=panel_4, SomeProperty=True)  # -> Values, Indices
value_listener_2 = ValueListener(Elements=add_elements.AddedElements, NameFilterS="Grid", SomeProperty=True)  # -> Values, Indices
deconstruct_4 = Deconstruct(Point=simplify(value_listener_2.Values))  # -> XComponent, YComponent, ZComponent
remap_numbers_7 = RemapNumbers(Value=deconstruct_4.XComponent, Source=Domain(0, 1), Target=construct_domain)  # -> Mapped, Clipped
remap_numbers_8 = RemapNumbers(Value=deconstruct_4.YComponent, Source=Domain(0, 1), Target=construct_domain_2)  # -> Mapped, Clipped
construct_point_4 = ConstructPoint(XCoordinate=remap_numbers_7.Mapped, YCoordinate=remap_numbers_8.Mapped, ZCoordinate=value_listener.Values)

# ----
# Define a field around the points
point = Point(flatten(construct_point_4))
negative = Negative(Value=Slider(0.71, range=0.01..2))
negative_2 = Negative(Value=Slider(0.69, range=0.01..2))
point_charge = PointCharge(Point=point, Charge=[Slider(0.25, range=0.01..2), Slider(0.33, range=0.01..2), negative_2, negative], Decay=2)
merge_fields = MergeFields(Fields=point_charge)

# ----
# Surface resolution
number_slider_2 = Slider(35, range=0..100)
range = Range(Domain=Domain(0, 1), Steps=expr("x-1", number_slider_2))
cross_reference = CrossReference(ListListA=range, ListListB=range, ListA=range, CrossMode=1)  # -> ListListA, ListListB, ListA
evaluate_box = EvaluateBox(
    Box=domain_box,
    UParameter=cross_reference.ListListA,
    VParameter=cross_reference.ListListB,
    WParameter=cross_reference.ListA)  # -> Plane, Point, Include

evaluate_field = EvaluateField(Field=merge_fields, Point=evaluate_box.Point)  # -> Tensor, Strength
iso_value = Slider(6.1e-05, range=0..0.01)
iso_surface = IsoSurface(
    Box=domain_box,
    Values=evaluate_field.Strength,
    XResolution=number_slider_2,
    YResolution=number_slider_2,
    ZResolution=number_slider_2,
    IsoValue=iso_value,
    MergeVertices=True)
weaverbird_s_catmull_clark_subdivision = WeaverbirdsCatmullClarkSubdivision(MeshCurves=iso_surface, Level=3, SmoothNakedEdges=1)
create_3d_view = Create3DView(MeshToDisplay=weaverbird_s_catmull_clark_subdivision, MeshColors=RGB(255, 0, 0), ViewWidth=300, ViewHeight=300)
custom_preview = CustomPreview(
    Geometry=weaverbird_s_catmull_clark_subdivision,
    Material={diffuse=RGB(221, 160, 221), emission=RGB(66, 48, 66), shine=0.5, specular=RGB(255, 255, 255), transparency=0})  # disabled
