# Grasshopper definition gradShowPrep_x5.gh (Grasshopper 1.0.7)
# plug-ins: Pufferfish, Weaverbird

# ----
# brepPrep
brep = Brep([<brep referenced from the Rhino model> x5])
bounding_box = BoundingBox(Content=brep, Plane=PlaneXY(0, 0, 0))  # -> Box, Box_2
deconstruct_brep = DeconstructBrep(Brep=bounding_box.Box)  # -> Faces, Edges, Vertices
list_item = ListItem(List=deconstruct_brep.Faces, Index=Slider(4, range=0..5), Wrap=True)
polygon_center = PolygonCenter(Polyline=list_item)  # -> CenterV, CenterE, flatten(CenterA)
point = Point(Point(0, 0, 0))
move_to_point = MoveToPoint(Geometry=brep, PointA=polygon_center.CenterA, PointB=point)  # -> Moved, Vector, Transform
settings_quality = SettingsQuality()
mesh_brep = MeshBrep(Brep=move_to_point.Moved, Settings=settings_quality)

mesh = Mesh([<mesh referenced from the Rhino model> x5])
bounding_box_2 = BoundingBox(Content=mesh, Plane=PlaneXY(0, 0, 0))  # -> Box, Box_2
deconstruct_box = DeconstructBox(Box=bounding_box_2.Box)  # -> Plane, X, Y, Z
deconstruct_brep_2 = DeconstructBrep(Brep=bounding_box_2.Box)  # -> Faces, Edges, Vertices
deconstruct_domain = DeconstructDomain(Domain=deconstruct_box.X)  # -> Start, End
deconstruct_domain_2 = DeconstructDomain(Domain=deconstruct_box.Y)  # -> Start, End
deconstruct_domain_3 = DeconstructDomain(Domain=deconstruct_box.Z)  # -> Start, End
list_item_2 = ListItem(List=deconstruct_brep_2.Faces, Index=Slider(4, range=0..5), Wrap=True)
subtraction = Subtraction(A=deconstruct_domain.Start, B=deconstruct_domain.End)
subtraction_2 = Subtraction(A=deconstruct_domain_2.Start, B=deconstruct_domain_2.End)
subtraction_3 = Subtraction(A=deconstruct_domain_3.Start, B=deconstruct_domain_3.End)
number_slider = Slider(127, range=0..1000)
polygon_center_2 = PolygonCenter(Polyline=list_item_2)  # -> CenterV, CenterE, flatten(CenterA)
absolute = Absolute(Value=subtraction)
absolute_2 = Absolute(Value=subtraction_2)
absolute_3 = Absolute(Value=subtraction_3)
point_2 = Point(Point(0, 0, 0))
move_to_point_2 = MoveToPoint(Geometry=mesh, PointA=polygon_center_2.CenterA, PointB=point_2)  # -> Moved, Vector, Transform
division = Division(A=absolute, B=number_slider)
division_2 = Division(A=absolute_2, B=number_slider)
division_3 = Division(A=absolute_3, B=Slider(157, range=0..1000))
list_length = ListLength(List=division)
number_slider_2 = Slider(1, range=0..1)
partition_list = PartitionList(List=[division, division_2, division_3], Size=list_length)
subtraction_4 = Subtraction(A=partition_list, B=number_slider_2)
subtraction_5 = Subtraction(A=number_slider_2, B=subtraction_4)
explode_tree = ExplodeTree(Data=subtraction_5)  # -> Branch0, Branch1, Branch2
list_item_3 = ListItem(List=[explode_tree.Branch0, explode_tree.Branch1], Index=0, Wrap=True)
sort_list = SortList(Keys=flatten(list_item_3))  # -> reverse(Keys), ValuesValuesA
list_item_4 = ListItem(List=Slider(2.32856, range=0..5), Index=0, Wrap=True)
point_3 = Point(Point(0, 0, 0))
# meshPrep
scale_nu = ScaleNU(Geometry=move_to_point_2.Moved, Plane=point_3, ScaleX=list_item_4, ScaleY=list_item_4, ScaleZ=list_item_4)  # -> Geometry, Transform

mesh_2 = Mesh([<mesh referenced from the Rhino model> x3])
explode_tree_2 = ExplodeTree(Data=graft(mesh_2))  # -> Branch0, Branch1, Branch2

mesh_3 = Mesh(<mesh referenced from the Rhino model>)
number_slider_3 = Slider(4, range=0..4)
panel = Panel("5")
list_item_5 = ListItem(List=scale_nu.Geometry, Index=number_slider_3, Wrap=True)
unit_z = UnitZ(Factor=expr("-x", Slider(5, range=0..29)))
move = Move(Geometry=list_item_5, Motion=unit_z)  # -> Geometry, Transform
mesh_split = MeshSplit(Mesh=move.Geometry, Splitters=mesh_3)
number_slider_4 = Slider(0, range=0..4)
mesh_statistics = MeshStatistics(Mesh=mesh_split)  # -> VertexCount, FaceCount, QuadFaceCount, TriangleFaceCount, ColorCount, PieceCount
sort_list_2 = SortList(Keys=mesh_statistics.FaceCount, ValuesValuesA=mesh_split)  # -> Keys, reverse(ValuesValuesA)
list_item_6 = ListItem(List=mesh_brep, Index=number_slider_3, Wrap=True)
mesh_4 = Mesh(<mesh referenced from the Rhino model>)  # disabled
list_item_7 = ListItem(List=sort_list_2.ValuesValuesA, Index=0, Wrap=True)
mesh_split_2 = MeshSplit(Mesh=list_item_7, Splitters=list_item_6)
mesh_statistics_2 = MeshStatistics(Mesh=mesh_split_2)  # -> VertexCount, FaceCount, QuadFaceCount, TriangleFaceCount, ColorCount, PieceCount
sort_list_3 = SortList(Keys=mesh_statistics_2.FaceCount, ValuesValuesA=mesh_split_2)  # -> Keys, reverse(ValuesValuesA)
number_slider_5 = Slider(2, range=0..10)
list_item_8 = ListItem(List=sort_list_3.ValuesValuesA, Index=Slider(0, range=0..1), Wrap=True)
align_vertices = AlignVertices(Mesh=list_item_8, Tolerance=0.01)  # -> Result, Count
offset_mesh = OffsetMesh(Mesh=list_item_8, Distance=number_slider_5, BothSides=0, CreateSolid=True)
weaverbird_s_mesh_thicken = WeaverbirdsMeshThicken(MeshCurves=align_vertices.Result, Distance=number_slider_5, OffsetType=0)
smooth_mesh = SmoothMesh(Mesh=weaverbird_s_mesh_thicken, Strength=0.5, SkipNaked=True, Iterations=1)
mesh_join = MeshJoin(Meshes=flatten([smooth_mesh, explode_tree_2.Branch1]))
