# Grasshopper definition gyroidMinimalSurface.gh (Grasshopper 1.0.7)
# plug-ins: Millipede, Pufferfish

number_slider = Slider(22, range=1..100)
addition = Addition(A=number_slider, B="1")
range = Range(Domain="-pi To pi", Steps=number_slider)
concatenate = Concatenate(FragmentA=Slider(1, range=1..10), FragmentB="*")
cross_reference = CrossReference(ListListA=range, ListListB=range, ListA=range, CrossMode=1)  # -> ListListA, ListListB, ListA
concatenate_2 = Concatenate(FragmentA=concatenate, FragmentB="cos(x)*sin(y)+cos(y)*sin(z)+cos(z)*sin(x)")
number_slider_2 = Slider(32, range=0..100)
evaluate = Evaluate(Expression=concatenate_2, x=cross_reference.ListListA, y=cross_reference.ListListB, z=cross_reference.ListA)
center_box = CenterBox(Base=PlaneXY(0, 0, 0), X=number_slider_2, Y=number_slider_2, Z=number_slider_2)
iso_surface = IsoSurface(
    Box=center_box,
    Values=evaluate,
    XResolution=addition,
    YResolution=addition,
    ZResolution=addition,
    IsoValue="0.001",
    MergeVertices=Toggle(True))
number_slider_3 = Slider(3, range=1..10)
box_array = BoxArray(Geometry=iso_surface, Cell=center_box, XCount=number_slider_3, YCount=number_slider_3, ZCount=number_slider_3)  # -> Geometry, Transform
mesh = Mesh(<mesh referenced from the Rhino model>)
bounding_box = BoundingBox(Content=mesh, Plane=PlaneXY(0, 0, 0), UnionBox=True)  # -> Box, Box_2
bounding_box_2 = BoundingBox(Content=box_array.Geometry, Plane=PlaneXY(0, 0, 0), UnionBox=True)  # -> Box, Box_2
deconstruct_brep = DeconstructBrep(Brep=bounding_box.Box)  # -> Faces, Edges, Vertices
deconstruct_brep_2 = DeconstructBrep(Brep=bounding_box_2.Box)  # -> Faces, Edges, Vertices
list_item = ListItem(List=deconstruct_brep.Faces, Index="4", Wrap=True)
list_item_2 = ListItem(List=deconstruct_brep_2.Faces, Index="4", Wrap=True)
area = Area(Geometry=list_item)  # -> Area, Centroid
area_2 = Area(Geometry=list_item_2)  # -> Area, Centroid
move_to_point = MoveToPoint(Geometry=mesh, PointA=area.Centroid, PointB="0,0,0")  # -> Moved, Vector, Transform
move_to_point_2 = MoveToPoint(Geometry=box_array.Geometry, PointA=area_2.Centroid, PointB="0,0,0")  # -> Moved, Vector, Transform
mesh_join = MeshJoin(Meshes=move_to_point_2.Moved)
mesh_split = MeshSplit(Mesh=mesh_join, Splitters=move_to_point.Moved)
