# Grasshopper definition interactionTests.gh (Grasshopper 1.0.7)
# plug-ins: Heteroptera, Pufferfish, MetaHopper, Human, LunchBox

# ----
# MIDI channels
# to listen for
panel = Panel("1")
series = Series(Start=panel, Step=1, Count="12")

trigger = Trigger(Interval=100, TimerInterval=100, Target=read_midi_dev_data)
readmididevice = Mandrill_Read_MIDI_Device(midi_dev="MPD226", preset_channel="1", mess_type="CC")  # -> data
# ---------- readmididevice: Python ----------
from os import path
from os import getenv
from scriptcontext import sticky 

sticky["MANDRILL_DATA_PATH"] = getenv("MANDRILL_DATA_PATH")

path=sticky["MANDRILL_DATA_PATH"]



ghenv.Component.Name = "Mandrill_Read_MIDI_Device"
ghenv.Component.NickName = 'readMIDIdevice'
ghenv.Component.Message = 'Mandrill\nVER 0.3.0\nDEC_04_2016'
ghenv.Component.IconDisplayMode = ghenv.Component.IconDisplayMode.application
ghenv.Component.Category = "Mandrill"
#ghenv.Component.SubCategory = "Xxxx"

MANDRILL_DATA_PATH = sticky["MANDRILL_DATA_PATH"]

#global MANDRILL_DATA_PATH
#print MANDRILL_DATA_PATH

if midi_dev == None:
    midi_dev = "LPD8"

if preset_channel == None:
    preset_channel = "1"

if mess_type == None:
    mess_type = "CC" #"CC","PC","Note_bool","Note_val" 


#MANDRILL_DATA_PATH = getenv("MANDRILL_DATA_PATH")
data = MANDRILL_DATA_PATH + "\\" + midi_dev  + "\\" + preset_channel + "\\" + str(mess_type) + ".bknobs"
# ---------- end readmididevice ----------

# ----
# testrig_sliders
number_slider = Slider(38, range=1..100)  # disabled
number_slider_2 = Slider(46, range=1..100)  # disabled
number_slider_3 = Slider(68, range=1..100)  # disabled
number_slider_4 = Slider(90, range=1..100)  # disabled
data = Data([number_slider_2, number_slider, number_slider_3, number_slider_4])  # disabled

# ----
# testrig_knobs
number_slider_5 = Slider(100, range=0..100)  # disabled
number_slider_6 = Slider(9, range=1..100)  # disabled
number_slider_7 = Slider(30, range=1..100)  # disabled
number_slider_8 = Slider(67, range=1..100)  # disabled
data_2 = Data([number_slider_5, number_slider_6, number_slider_7, number_slider_8])  # disabled

# ----
# testrig_buttons
panel_2 = Panel("""0
0
1
1""")  # disabled
data_3 = Data(panel_2)  # disabled

trigger_2 = Trigger(Interval=200, TimerInterval=200, Target=read_midi_dev_data_2)

# ----
# MIDI channel select
panel_3 = Panel("0")
series_2 = Series(Start=panel_3, Step=1, Count="16")

readmididevice_2 = Mandrill_Read_MIDI_Device(midi_dev="MPD226", preset_channel="2", mess_type="Note_bool")  # -> data; same code as readmididevice
brep = Brep(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)  # disabled
read_midi_dev_data = Mandrill_Read_MIDI_Device(data=readmididevice, channels=series)  # -> values; inputs channels: list of Int32
# ---------- read_midi_dev_data: Python ----------
ghenv.Component.Name = "Mandrill_Read_MIDI_Device"
ghenv.Component.NickName = 'read_MIDI_dev_data'
ghenv.Component.Message = 'Mandrill\nVER 0.3.0\nDEC_04_2016'
ghenv.Component.IconDisplayMode = ghenv.Component.IconDisplayMode.application
ghenv.Component.Category = "Mandrill"

data_list = []
values = []

if channels == None:
    channels = "1"

with open(data, "rb") as f:
    byte = f.read(1)
    while byte != "":
        data_list.append(ord(byte))
        byte = f.read(1)
for item in channels:
    values.append(data_list[int(item)])
# ---------- end read_midi_dev_data ----------
deconstruct_brep = DeconstructBrep(Brep=brep)  # -> Faces, Edges, Vertices; disabled
hold = Hold(Data=read_midi_dev_data)
panel_4 = Panel("4")  # disabled
read_midi_dev_data_2 = Mandrill_Read_MIDI_Device(data=readmididevice_2, channels=series_2)  # -> values; inputs channels: list of Int32; same code as read_midi_dev_data

# ----
# testrig_drumpad
panel_5 = Panel("""0
1
1
1
0
0
0
1
0
1
0
1
0
1
0
1""")  # disabled
boolean = Boolean(panel_5)  # disabled

data_4 = Data([data_2, data, data_3])  # disabled
hold_2 = Hold(Data=read_midi_dev_data_2)

# ----
# grid construction XZ axis
number_slider_9 = Slider(64, range=1..500)
xz_plane = XZPlane(Origin=Point(0, 0, 0))
rectangular = Rectangular(Plane=xz_plane, SizeX=number_slider_9, SizeY=Slider(200, range=1..500), ExtentX="3", ExtentY="3")  # -> Cells, Points
flip_matrix = FlipMatrix(Data=rectangular.Points)
cull_pattern = CullPattern(List=flatten(flip_matrix), CullPattern=hold_2)

panel_6 = Panel(hold_2)
partition_list = PartitionList(List=hold, Size="4")  # -> simplify(Chunks)
explode_tree = ExplodeTree(Data=partition_list)  # -> Branch0, Branch1, Branch2
explode_tree_2 = ExplodeTree(Data=explode_tree.Branch1)  # -> Branch0, Branch1, Branch2, Branch3; disabled
panel_7 = Panel(explode_tree.Branch1)  # disabled
panel_8 = Panel("""{0} Knobs 
{1} Sliders
{2} Buttons""")
explode_tree_3 = ExplodeTree(Data=graft(explode_tree.Branch2))  # -> Branch0, Branch1, Branch2, Branch3
panel_9 = Panel(explode_tree.Branch1)
panel_10 = Panel(explode_tree.Branch0)
panel_11 = Panel(explode_tree.Branch2)
boolean_2 = Boolean(explode_tree.Branch2)
explode_tree_4 = ExplodeTree(Data=graft(explode_tree.Branch1))  # -> Branch0, Branch1, Branch2, Branch3
data_5 = Data(explode_tree_4.Branch0)
data_6 = Data(explode_tree_4.Branch1)
data_7 = Data(explode_tree_4.Branch3)
data_8 = Data(explode_tree_4.Branch2)

# ----
# primitive shape slider test
panel_12 = Panel("100")  # disabled
cylinder = Cylinder(Base=PlaneXY(0, 0, 0), Radius=panel_12, Length=panel_12)  # disabled
sphere = Sphere(Base=PlaneXY(0, 0, 0), Radius=panel_12)  # disabled
cone = Cone(Base=PlaneXY(0, 0, 0), Radius=panel_12, Length=panel_12)  # -> Cone, Tip; disabled
center_box = CenterBox(Base=PlaneXY(0, 0, 0), X=panel_12, Y=panel_12, Z=panel_12)  # disabled
panel_13 = Panel("5000")  # disabled
series_3 = Series(Start=panel_13, Step=panel_13, Count=4)  # disabled
relay = Relay([cylinder, sphere])  # disabled
unit_x = UnitX(Factor=series_3)  # disabled
relay_2 = Relay([relay, cone.Cone, center_box])  # disabled
move = Move(Geometry=relay_2, Motion=unit_x)  # -> graft(Geometry), Transform; disabled
bounding_box = BoundingBox(Content=move.Geometry, Plane=PlaneXY(0, 0, 0))  # -> Box, Box_2; disabled
area = Area(Geometry=bounding_box.Box)  # -> Area, Centroid; disabled
scale = Scale(Geometry=move.Geometry, Center=area.Centroid, Factor=graft(explode_tree.Branch1))  # -> Geometry, Transform; disabled

panel_14 = Panel("-1 To 100")  # disabled

# ----
# Curved top intersection
series_4 = Series(Start=0, Step=1, Count=panel_4)  # disabled
list_item = ListItem(List=deconstruct_brep.Vertices, Index=series_4, Wrap=True)  # -> graft(Item); disabled
panel_15 = Panel("0")  # disabled
construct_domain = ConstructDomain(DomainStart=panel_15, DomainEnd=expr("x-1", explode_tree.Branch1))  # disabled
deconstruct = Deconstruct(Point=list_item)  # -> XComponent, YComponent, ZComponent; disabled
remap_numbers = RemapNumbers(Value=explode_tree.Branch1, Source=panel_14, Target=construct_domain)  # -> graft(Mapped), Clipped; disabled
construct_point = ConstructPoint(XCoordinate=deconstruct.XComponent, YCoordinate=deconstruct.YComponent, ZCoordinate=remap_numbers.Mapped)  # disabled
explode_tree_5 = ExplodeTree(Data=simplify(construct_point))  # -> Branch0, Branch1, Branch2, Branch3; disabled
_4point_surface = _4PointSurface(
    CornerA=explode_tree_5.Branch0,
    CornerB=explode_tree_5.Branch1,
    CornerC=explode_tree_5.Branch2,
    CornerD=explode_tree_5.Branch3)  # disabled

# ----
# Angled top intersection
series_5 = Series(Start=panel_4, Step=1, Count=panel_4)  # disabled
panel_16 = Panel("0 To 100")  # disabled
panel_17 = Panel("100 To 0")  # disabled
remap_numbers_2 = RemapNumbers(Value=explode_tree.Branch1, Source=panel_16, Target=panel_17)  # -> Mapped, Clipped; disabled
negative = Negative(Value=explode_tree.Branch1)  # disabled
list_item_2 = ListItem(List=deconstruct_brep.Edges, Index=series_5, Wrap=True)  # disabled
panel_18 = Panel("0")  # disabled
construct_domain_2 = ConstructDomain(DomainStart=panel_18, DomainEnd=negative)  # disabled
remap_numbers_3 = RemapNumbers(Value=remap_numbers_2.Mapped, Source=panel_14, Target=construct_domain_2)  # -> Mapped, Clipped; disabled
unit_z = UnitZ(Factor=remap_numbers_3.Mapped)  # disabled
move_2 = Move(Geometry=list_item_2, Motion=unit_z)  # -> Geometry, Transform; disabled
dispatch = Dispatch(List=move_2.Geometry, DispatchPattern=[True, False])  # -> ListA, ListB; disabled
network_surface = NetworkSurface(CurvesU=dispatch.ListA, CurvesV=dispatch.ListB, Continuity=2)  # disabled

# ----
# Surface from points to create a planar shape
number_slider_10 = Slider(2, range=1..3)  # disabled
list_length = ListLength(List=cull_pattern)  # disabled
division = Division(A=list_length, B=number_slider_10)  # disabled
surface_from_points = SurfaceFromPoints(Points=cull_pattern, UCount=division, Interpolate=True)  # disabled

deconstruct_2 = Deconstruct(Point=cull_pattern)  # -> XComponent, YComponent, ZComponent; disabled
sort_list = SortList(Keys=deconstruct_2.ZComponent, ValuesValuesA=cull_pattern)  # -> Keys, ValuesValuesA; disabled

# ----
# 'interpolate or polyline' curve
# selection decision with button 4
interpolate = Interpolate(Vertices=sort_list.ValuesValuesA, Degree=3, Periodic=False, KnotStyle=1)  # -> Curve, Length, Domain; disabled
polyline = PolyLine(Vertices=sort_list.ValuesValuesA, Closed=False)  # disabled
panel_19 = Panel("3")  # disabled
list_item_3 = ListItem(List=boolean_2, Index=panel_19, Wrap=True)  # disabled
panel_20 = Panel("""0
1""")  # disabled
panel_21 = Panel("""1
0""")  # disabled
relay_3 = Relay([interpolate.Curve, polyline])  # disabled
expression = Expression(bool=list_item_3, a=panel_20, b=panel_21, Expression="If(bool=True, a, b)")  # disabled
dispatch_2 = Dispatch(List=relay_3, DispatchPattern=expression)  # -> ListA, ListB; disabled

panel_22 = Panel(unit_z)  # disabled
number_slider_11 = Slider(1319, range=0..1500)  # disabled

relay_4 = Relay([network_surface, _4point_surface])  # disabled
boolean_3 = Boolean()  # disabled
integer = Integer(boolean_3)  # disabled
list_item_4 = ListItem(List=flatten(relay_4), Index=integer, Wrap=True)  # disabled

curve = Curve(dispatch_2.ListA)  # disabled
unit_x_2 = UnitX(Factor=number_slider_11)  # disabled
panel_23 = Panel("Red")  # disabled
number_slider_12 = Slider(6, range=0..10)  # disabled
number_slider_13 = Slider(150, range=0..1000)  # disabled
number_slider_14 = Slider(250, range=0..1000)  # disabled

data_9 = Data(explode_tree.Branch0)  # disabled
explode_tree_6 = ExplodeTree(Data=simplify(graft(data_9)))  # -> Branch0, Branch1, Branch2, Branch3; disabled
panel_24 = Panel("0 To 100")  # disabled
panel_25 = Panel("0 To 300")  # disabled
panel_26 = Panel("0 To 100")  # disabled
panel_27 = Panel("100 To 300")  # disabled
number_slider_15 = Slider(6, range=0..10)  # disabled
remap_numbers_4 = RemapNumbers(Value=explode_tree_6.Branch0, Source=panel_26, Target=panel_25)  # -> Mapped, Clipped; disabled
panel_28 = Panel("100 To 300")  # disabled
panel_29 = Panel("0 To 100")  # disabled
remap_numbers_5 = RemapNumbers(Value=explode_tree_6.Branch1, Source=panel_24, Target=panel_27)  # -> Mapped, Clipped; disabled
number_slider_16 = Slider(234, range=0..1000)  # disabled
point = Point(Point(0, 0, 0))  # disabled
remap_numbers_6 = RemapNumbers(Value=explode_tree_6.Branch2, Source=panel_29, Target=panel_28)  # -> Mapped, Clipped; disabled
panel_30 = Panel("0")  # disabled
series_6 = Series(Start=panel_30, Step=remap_numbers_5.Mapped, Count=number_slider_15)  # disabled
number_slider_17 = Slider(100, range=0..100)  # disabled
unit_y = UnitY(Factor=remap_numbers_4.Mapped)  # disabled
move_3 = Move(Geometry=point, Motion=unit_y)  # -> Geometry, Transform; disabled
unit_z_2 = UnitZ(Factor=number_slider_17)  # disabled
unit_z_3 = UnitZ(Factor=series_6)  # disabled
move_4 = Move(Geometry=move_3.Geometry, Motion=unit_z_2)  # -> Geometry, Transform; disabled
number_slider_18 = Slider(100, range=0..100)  # disabled
move_5 = Move(Geometry=graft([point, move_4.Geometry]), Motion=unit_z_3)  # -> Geometry, Transform; disabled
flip_matrix_2 = FlipMatrix(Data=move_5.Geometry)  # disabled
number_slider_19 = Slider(300, range=0..300)  # disabled
circle = Circle(Plane=flip_matrix_2, Radius=remap_numbers_6.Mapped)  # -> flatten(Circle); disabled
loft = Loft(Curves=circle, Options={Adjust=False, Closed=False, LoftEnds=0, LoftSimp=0, LoftType=0, Rebuild=10, Refit=0.01})  # disabled
number_slider_20 = Slider(5, range=0..10)  # disabled
bounding_box_2 = BoundingBox(Content=loft, Plane=PlaneXY(0, 0, 0))  # -> Box, Box_2; disabled
panel_31 = Panel("4")  # disabled
brepfaces = BrepFaces(brep=bounding_box_2.Box, index=panel_31)  # -> i, centroid; disabled
brepfaces_2 = BrepFaces(brep=bounding_box_2.Box, index=number_slider_20)  # -> i, centroid; disabled
number_slider_21 = Slider(0.66, range=0..1)  # disabled
number_slider_22 = Slider(0, range=0..1)  # disabled
brep_edges = BrepEdges(Brep=brepfaces.i)  # -> Naked, Interior, NonManifold; disabled
distance = Distance(PointA=brepfaces_2.centroid, PointB=brepfaces.centroid)  # disabled
list_item_5 = ListItem(List=brep_edges.Naked, Index=number_slider_22, Wrap=True)  # disabled
multiplication = Multiplication(A=distance, B=number_slider_21)  # disabled
panel_32 = Panel("-25")  # disabled
number_slider_23 = Slider(100, range=0..100)  # disabled
number_slider_24 = Slider(2, range=0..10)  # disabled
length = Length(Curve=list_item_5)  # disabled
unit_z_4 = UnitZ(Factor=multiplication)  # disabled
division_2 = Division(A=length, B=number_slider_24)  # disabled
circle_2 = Circle(Plane=brepfaces.centroid, Radius=length)  # disabled
circle_3 = Circle(Plane=brepfaces.centroid, Radius=number_slider_23)  # disabled
unit_z_5 = UnitZ(Factor=expr("x*2", panel_32))  # disabled
extrude = Extrude(Base=circle_2, Direction=unit_z_5)  # disabled
extrude_2 = Extrude(Base=circle_3, Direction=unit_z_4)  # disabled
panel_33 = Panel("White")  # disabled
data_10 = Data(flatten([loft, extrude_2, extrude]))  # disabled
cap_holes = CapHoles(Brep=data_10)  # disabled
panel_34 = Panel(cap_holes)  # disabled
panel_35 = Panel("-360 To 360")  # disabled
panel_36 = Panel("0 To 100")  # disabled
remap_numbers_7 = RemapNumbers(Value=explode_tree_6.Branch3, Source=panel_36, Target=panel_35)  # -> Mapped, Clipped; disabled
rotate = Rotate(Geometry=cap_holes, Angle=degrees(remap_numbers_7.Mapped), Plane=brepfaces.centroid)  # -> Geometry, Transform; disabled
custom_preview = CustomPreview(Geometry=rotate.Geometry, Material=panel_33)  # disabled

custom_preview_lineweights = CustomPreviewLineweights(Geometry=curve, Shader=panel_23, Thickness=number_slider_12, Absolute=False)  # disabled
domain_box = DomainBox(Base=PlaneXY(0, 0, 0), X=number_slider_13, Y=number_slider_13, Z=number_slider_14)  # disabled

# ----
# Parabola - vertices
# Flat plane - edges
# Geometry selection
bounding_box_3 = BoundingBox(Content=flatten(domain_box), Plane=PlaneXY(0, 0, 0), UnionBox=True)  # -> Box, Box_2; disabled
deconstruct_brep_2 = DeconstructBrep(Brep=bounding_box_3.Box)  # -> Faces, Edges, Vertices; disabled
panel_37 = Panel("4")  # disabled
panel_38 = Panel("4")  # disabled
series_7 = Series(Start=0, Step=1, Count=panel_38)  # disabled
series_8 = Series(Start=panel_37, Step=1, Count=panel_37)  # disabled
list_item_6 = ListItem(List=deconstruct_brep_2.Vertices, Index=series_7, Wrap=True)  # -> graft(Item); disabled
list_item_7 = ListItem(List=deconstruct_brep_2.Edges, Index=series_8, Wrap=True)  # disabled

# ----
# Find Height
panel_39 = Panel("5")  # disabled
brepfaces_3 = BrepFaces(brep=bounding_box_3.Box, index=panel_39)  # -> i, centroid; disabled
deconstruct_3 = Deconstruct(Point=brepfaces_3.centroid)  # -> XComponent, YComponent, ZComponent; disabled
panel_40 = Panel("0")  # disabled
construct_domain_3 = ConstructDomain(DomainStart=panel_40, DomainEnd=deconstruct_3.ZComponent)  # disabled

bed_size_mjf_580 = Panel("190 x 332 x 248")
lamp_max = Panel("190 x 190 x 240")
domain_box_2 = DomainBox(Base=PlaneXY(0, 0, 0), X="0 To 195", Y="0 To 195", Z="290")
brepfaces_4 = BrepFaces(brep=domain_box_2, index="4")  # -> i, centroid
move_to_point = MoveToPoint(Geometry=domain_box_2, PointA=brepfaces_4.centroid, PointB="0,0,0")  # -> Moved, Vector, Transform

knob_0 = Slider(100, range=0..100)
knob_3 = Slider(65, range=3..98)
fr = Slider(100, range=0..100)
br = Slider(100, range=0..100)
bl = Slider(100, range=0..100)
knob_1 = Slider(98, range=3..98)
fl = Slider(100, range=0..100)
knob_2 = Slider(40, range=3..98)
panel_41 = Panel("0 To 100")  # disabled

# ----
# Curved top intersection
deconstruct_4 = Deconstruct(Point=list_item_6)  # -> XComponent, YComponent, ZComponent; disabled
remap_numbers_8 = RemapNumbers(Value=explode_tree.Branch1, Source=panel_41, Target=construct_domain_3)  # -> graft(Mapped), Clipped; disabled
construct_point_2 = ConstructPoint(XCoordinate=deconstruct_4.XComponent, YCoordinate=deconstruct_4.YComponent, ZCoordinate=remap_numbers_8.Mapped)  # disabled
explode_tree_7 = ExplodeTree(Data=simplify(construct_point_2))  # -> Branch0, Branch1, Branch2, Branch3; disabled
_4point_surface_2 = _4PointSurface(
    CornerA=explode_tree_7.Branch0,
    CornerB=explode_tree_7.Branch1,
    CornerC=explode_tree_7.Branch2,
    CornerD=explode_tree_7.Branch3)  # disabled
deconstruct_brep_3 = DeconstructBrep(Brep=_4point_surface_2)  # -> Faces, simplify(graft(Edges)), Vertices; disabled
panel_42 = Panel("""0
1
2
3""")  # disabled
list_item_8 = ListItem(List=deconstruct_brep_2.Edges, Index=panel_42, Wrap=True)  # -> simplify(graft(Item)); disabled
merge = Merge(Data1=list_item_8, Data2=deconstruct_brep_3.Edges)  # disabled
loft_2 = Loft(Curves=merge, Options={Adjust=False, Closed=False, LoftEnds=0, LoftSimp=0, LoftType=0, Rebuild=10, Refit=0.01})  # disabled
brep_join = BrepJoin(Breps=flatten([loft_2, _4point_surface_2]))  # -> Breps, Closed; disabled
cap_holes_2 = CapHoles(Brep=brep_join.Breps)  # disabled

# ----
# Angled top intersection
negative_2 = Negative(Value=deconstruct_3.ZComponent)  # disabled
construct_domain_4 = ConstructDomain(DomainStart=panel_40, DomainEnd=negative_2)  # disabled
remap_numbers_9 = RemapNumbers(Value=explode_tree.Branch1, Source=panel_41, Target=construct_domain_4)  # -> Mapped, Clipped; disabled
unit_z_6 = UnitZ(Factor=remap_numbers_9.Mapped)  # disabled
move_6 = Move(Geometry=list_item_7, Motion=unit_z_6)  # -> Geometry, Transform; disabled
dispatch_3 = Dispatch(List=move_6.Geometry, DispatchPattern=[True, False])  # -> ListA, ListB; disabled
network_surface_2 = NetworkSurface(CurvesU=dispatch_3.ListA, CurvesV=dispatch_3.ListB, Continuity=2)  # disabled
deconstruct_brep_4 = DeconstructBrep(Brep=network_surface_2)  # -> Faces, Edges, Vertices; disabled
flip_curve = FlipCurve(Curve=deconstruct_brep_4.Edges)  # -> Curve, Flag; disabled
panel_43 = Panel("""0
3
2
1""")  # disabled
sort_list_2 = SortList(Keys=panel_43, ValuesValuesA=flip_curve.Curve)  # -> Keys, simplify(graft(ValuesValuesA)); disabled
merge_2 = Merge(Data1=list_item_8, Data2=sort_list_2.ValuesValuesA)  # disabled
loft_3 = Loft(Curves=merge_2, Options={Adjust=False, Closed=False, LoftEnds=0, LoftSimp=0, LoftType=0, Rebuild=10, Refit=0.01})  # disabled
brep_join_2 = BrepJoin(Breps=flatten([network_surface_2, loft_3]))  # -> Breps, Closed; disabled
cap_holes_3 = CapHoles(Brep=brep_join_2.Breps)  # disabled

object_bake = ObjectBake(BakeToggle=Button(), Layer="GH_Bake", ObjectName="GH_Obj", ObjectColor=RGB(255, 255, 255), LayerColor=RGB(255, 255, 255))
button_0 = BooleanToggle(False)
data_11 = Data(graft(knob_0))
data_12 = Data(knob_1)
data_13 = Data(knob_3)
data_14 = Data(knob_2)

# ----
# XY size bounds
width = Panel("130")
construct_domain_5 = ConstructDomain(DomainStart=width, DomainEnd="195")
remap_numbers_10 = RemapNumbers(Value=data_11, Source="0 To 100", Target=construct_domain_5)  # -> Mapped, Clipped
construct_domain_6 = ConstructDomain(DomainStart="0", DomainEnd=remap_numbers_10.Mapped)

insert_items = InsertItems(List=data_5, Item=data_6, Indices="1", Wrap=True)
insert_items_2 = InsertItems(List=insert_items, Item=data_8, Indices="2", Wrap=True)
insert_items_3 = InsertItems(List=insert_items_2, Item=data_7, Indices="3", Wrap=True)
sliders = Data(insert_items_3)

# ----
# Rotate the piece around the view
panel_44 = Panel("3")  # disabled
list_item_9 = ListItem(List=explode_tree.Branch0, Index=panel_44, Wrap=True)  # disabled
panel_45 = Panel("-360 To 360")  # disabled
panel_46 = Panel("0 To 100")  # disabled
remap_numbers_11 = RemapNumbers(Value=list_item_9, Source=panel_46, Target=panel_45)  # -> Mapped, Clipped; disabled

# ----
# move into position
domain_box_3 = DomainBox(Base=PlaneXY(0, 0, 0), X=construct_domain_6, Y=construct_domain_6, Z="290")
brepfaces_5 = BrepFaces(brep=move_to_point.Moved, index="4")  # -> i, centroid
brepfaces_6 = BrepFaces(brep=domain_box_3, index="4")  # -> i, centroid
move_to_point_2 = MoveToPoint(Geometry=domain_box_3, PointA=brepfaces_6.centroid, PointB=brepfaces_5.centroid)  # -> Moved, Vector, Transform

insert_items_4 = InsertItems(List=data_14, Item=data_12, Indices="0", Wrap=True)
insert_items_5 = InsertItems(List=insert_items_4, Item=data_13, Indices="2", Wrap=True)
number_slider_25 = Slider(4, range=0..10)
deconstruct_brep_5 = DeconstructBrep(Brep=move_to_point_2.Moved)  # -> Faces, Edges, Vertices

# ----
# Curved top intersection
series_9 = Series(Start=0, Step=1, Count="4")
list_item_10 = ListItem(List=deconstruct_brep_5.Vertices, Index=series_9, Wrap=True)  # -> graft(Item)
construct_domain_7 = ConstructDomain(DomainStart="0", DomainEnd=expr("x-1", "290"))
deconstruct_5 = Deconstruct(Point=list_item_10)  # -> XComponent, YComponent, ZComponent
remap_numbers_12 = RemapNumbers(Value=sliders, Source="-1 To 100", Target=construct_domain_7)  # -> graft(Mapped), Clipped
construct_point_3 = ConstructPoint(XCoordinate=deconstruct_5.XComponent, YCoordinate=deconstruct_5.YComponent, ZCoordinate=remap_numbers_12.Mapped)
explode_tree_8 = ExplodeTree(Data=simplify(construct_point_3))  # -> Branch0, Branch1, Branch2, Branch3
_4point_surface_3 = _4PointSurface(
    CornerA=explode_tree_8.Branch0,
    CornerB=explode_tree_8.Branch1,
    CornerC=explode_tree_8.Branch2,
    CornerD=explode_tree_8.Branch3)

# ----
# Angled top intersection
series_10 = Series(Start="4", Step=1, Count="4")
remap_numbers_13 = RemapNumbers(Value=sliders, Source="0 To 100", Target="100 To 0")  # -> Mapped, Clipped
negative_3 = Negative(Value="290")
list_item_11 = ListItem(List=deconstruct_brep_5.Edges, Index=series_10, Wrap=True)
construct_domain_8 = ConstructDomain(DomainStart="0", DomainEnd=negative_3)
remap_numbers_14 = RemapNumbers(Value=remap_numbers_13.Mapped, Source="-1 To 100", Target=construct_domain_8)  # -> Mapped, Clipped
unit_z_7 = UnitZ(Factor=remap_numbers_14.Mapped)
move_7 = Move(Geometry=list_item_11, Motion=unit_z_7)  # -> Geometry, Transform
dispatch_4 = Dispatch(List=move_7.Geometry, DispatchPattern=[True, False])  # -> ListA, ListB
network_surface_3 = NetworkSurface(CurvesU=dispatch_4.ListA, CurvesV=dispatch_4.ListB, Continuity=2)

relay_5 = Relay([network_surface_3, _4point_surface_3])
boolean_4 = Boolean(explode_tree_3.Branch0)
integer_2 = Integer(boolean_4)
list_item_12 = ListItem(List=flatten(relay_5), Index=integer_2, Wrap=True)

brep_edges_2 = BrepEdges(Brep=list_item_12)  # -> Naked, Interior, NonManifold
split_brep = SplitBrep(Brep=move_to_point_2.Moved, Cutter=list_item_12)
area_2 = Area(Geometry=split_brep)  # -> Area, Centroid
deconstruct_6 = Deconstruct(Point=area_2.Centroid)  # -> XComponent, YComponent, ZComponent
sort_list_3 = SortList(Keys=deconstruct_6.ZComponent, ValuesA=split_brep)  # -> Keys, ValuesA
list_item_13 = ListItem(List=sort_list_3.ValuesA, Index=0, Wrap=True)
custom_preview_2 = CustomPreview(Geometry=[list_item_13, list_item_12], Material="White")

# ----
# Rotate V
panel_47 = Panel("0 To 100")  # disabled
panel_48 = Panel("0 To 300")  # disabled
domain_box_4 = DomainBox(Base=PlaneXY(0, 0, 0), X=panel_47, Y=panel_47, Z=panel_48)  # disabled
panel_49 = Panel("1")  # disabled
list_item_14 = ListItem(List=explode_tree.Branch0, Index=panel_49, Wrap=True)  # disabled
panel_50 = Panel("-360 To 360")  # disabled
panel_51 = Panel("0 To 100")  # disabled
remap_numbers_15 = RemapNumbers(Value=list_item_14, Source=panel_51, Target=panel_50)  # -> Mapped, Clipped; disabled
panel_52 = Panel("4")  # disabled
brepfaces_7 = BrepFaces(brep=domain_box_4, index=panel_52)  # -> i, centroid; disabled

# ----
# Adjust Z height
panel_53 = Panel("5")  # disabled
brepfaces_8 = BrepFaces(brep=domain_box_4, index=panel_53)  # -> i, centroid; disabled
panel_54 = Panel("0")  # disabled
list_item_15 = ListItem(List=explode_tree.Branch1, Index=panel_54, Wrap=True)  # disabled
panel_55 = Panel("1 To 100")  # disabled
panel_56 = Panel("-300 To 0")  # disabled
remap_numbers_16 = RemapNumbers(Value=list_item_15, Source=panel_55, Target=panel_56)  # -> Mapped, Clipped; disabled
deconstruct_7 = Deconstruct(Point=brepfaces_8.centroid)  # -> XComponent, YComponent, ZComponent; disabled
addition = Addition(A=remap_numbers_16.Mapped, B=deconstruct_7.ZComponent)  # disabled
construct_point_4 = ConstructPoint(XCoordinate=deconstruct_7.XComponent, YCoordinate=deconstruct_7.YComponent, ZCoordinate=addition)  # disabled

# ----
# Rotate U
panel_57 = Panel("0")  # disabled
list_item_16 = ListItem(List=explode_tree.Branch0, Index=panel_57, Wrap=True)  # disabled
panel_58 = Panel("0 To 100")  # disabled
panel_59 = Panel("-360 To 360")  # disabled
remap_numbers_17 = RemapNumbers(Value=list_item_16, Source=panel_58, Target=panel_59)  # -> Mapped, Clipped; disabled
rotate_plane = RotatePlane(Plane=construct_point_4, Angle=degrees(remap_numbers_17.Mapped))  # disabled

# ----
# Varying grid density with data dam
# Data Dam Controlled by toggle
panel_60 = Panel("0")  # disabled
list_item_17 = ListItem(List=explode_tree.Branch0, Index=panel_60, Wrap=True)  # disabled
panel_61 = Panel("0 To 100")  # disabled
panel_62 = Panel("4 To 20")  # disabled
number_slider_26 = Slider(160, range=100..300)  # disabled
number_slider_27 = Slider(300, range=100..300)  # disabled
remap_numbers_18 = RemapNumbers(Value=list_item_17, Source=panel_61, Target=panel_62)  # -> Mapped, Clipped; disabled
panel_63 = Panel("2")  # disabled
multiplication_2 = Multiplication(A=remap_numbers_18.Mapped, B=panel_63)  # disabled
division_3 = Division(A=number_slider_26, B=multiplication_2)  # disabled
domain_box_5 = DomainBox(Base=PlaneXY(0, 0, 0), X=number_slider_26, Y=number_slider_26, Z=number_slider_27)  # disabled
division_4 = Division(A=number_slider_27, B=multiplication_2)  # disabled
x_plus_one = XPlusOne(NumberX=division_4)  # disabled
x_plus_one_2 = XPlusOne(NumberX=division_3)  # disabled
panel_64 = Panel("0")  # disabled
list_item_18 = ListItem(List=boolean_2, Index=panel_64, Wrap=True)  # disabled

# ----
# Construct Grid
series_11 = Series(Start=0, Step=multiplication_2, Count=x_plus_one_2)  # disabled
series_12 = Series(Start=0, Step=multiplication_2, Count=x_plus_one)  # disabled
construct_point_5 = ConstructPoint(XCoordinate=graft(series_11), YCoordinate=series_11, ZCoordinate=0)  # -> simplify(Point); disabled
unit_z_8 = UnitZ(Factor=series_12)  # disabled
move_8 = Move(Geometry=flatten(construct_point_5), Motion=graft(unit_z_8))  # -> Geometry, Transform; disabled

data_dam = DataDam(DataDataA=move_8.Geometry, BufferDelay=5000000, BufferMode=0)  # disabled
get_objects_in_group = GetObjectsInGroup()  # disabled

set_object_value = SetObjectValue(ObjectToSet=get_objects_in_group, ValueToSet=list_item_18)  # disabled

# ----
# revolve and preview
panel_65 = Panel("-100,0,0")  # disabled
panel_66 = Panel("0,0,1")  # disabled
line_sdl = LineSDL(Start=panel_65, Direction=panel_66, Length=1)  # disabled
revolution = Revolution(Curve=dispatch_2.ListA, Axis=line_sdl, Domain=Domain(0, 6.283185307))  # disabled
panel_67 = Panel("White")  # disabled
panel_68 = Panel("Grey")  # disabled
create_material = CreateMaterial(Diffuse=panel_67, Specular=RGB(255, 255, 255), Emission=panel_68, Transparency=0, Shine=0)  # disabled
mesh_brep = MeshBrep(
    Brep=revolution,
    Settings={GridMaxCount=0, GridMinCount=16, JaggedSeams=False, MaxEdgeLength=0, MinEdgeLength=0.0001, MinTolerance=0, Refine=True, RefineAngle=0, RelativeTolerance=0.65, SimplePlanes=True, Tolerance=0})  # disabled

move_9 = Move(Geometry=mesh_brep, Motion=unit_x_2)  # -> Geometry, Transform; disabled

custom_preview_3 = CustomPreview(Geometry=move_9.Geometry, Material=create_material)  # disabled

deconstruct_plane = DeconstructPlane(Plane=rotate_plane)  # -> Origin, XAxis, YAxis, ZAxis; disabled
construct_plane = ConstructPlane(Origin=deconstruct_plane.Origin, XAxis=deconstruct_plane.XAxis, YAxis=deconstruct_plane.ZAxis)  # disabled
rotate_2 = Rotate(Geometry=rotate_plane, Angle=degrees(remap_numbers_15.Mapped), Plane=construct_plane)  # -> Geometry, Transform; disabled

# ----
# Rotate W
panel_69 = Panel("2")  # disabled
list_item_19 = ListItem(List=explode_tree.Branch0, Index=panel_69, Wrap=True)  # disabled
deconstruct_plane_2 = DeconstructPlane(Plane=rotate_plane)  # -> Origin, XAxis, YAxis, ZAxis; disabled
panel_70 = Panel("-360 To 360")  # disabled
panel_71 = Panel("0 To 100")  # disabled
remap_numbers_19 = RemapNumbers(Value=list_item_19, Source=panel_71, Target=panel_70)  # -> Mapped, Clipped; disabled
construct_plane_2 = ConstructPlane(Origin=deconstruct_plane_2.Origin, XAxis=deconstruct_plane_2.ZAxis, YAxis=deconstruct_plane_2.YAxis)  # disabled
rotate_3 = Rotate(Geometry=rotate_2.Geometry, Angle=degrees(remap_numbers_19.Mapped), Plane=construct_plane_2)  # -> Geometry, Transform; disabled

# ----
# Intersect and Trim
plane_through_shape = PlaneThroughShape(Plane=rotate_3.Geometry, Shape=domain_box_4, Inflate=1, SectionLogic=False)  # disabled
split_brep_2 = SplitBrep(Brep=domain_box_4, Cutter=plane_through_shape)  # disabled
area_3 = Area(Geometry=split_brep_2)  # -> Area, Centroid; disabled
deconstruct_8 = Deconstruct(Point=area_3.Centroid)  # -> XComponent, YComponent, ZComponent; disabled
sort_list_4 = SortList(Keys=deconstruct_8.ZComponent, ValuesValuesA=split_brep_2)  # -> Keys, ValuesValuesA; disabled
panel_72 = Panel("1")  # disabled
cull_index = CullIndex(List=sort_list_4.ValuesValuesA, Indices=panel_72, Wrap=True)  # disabled

rotate_4 = Rotate(Geometry=cull_index, Angle=remap_numbers_11.Mapped, Plane=brepfaces_7.centroid)  # -> Geometry, Transform; disabled

# ==== cluster BrepFaces: Select a face of a brep and find the centre
brep = ClusterInput()
deconstruct_brep = DeconstructBrep(Brep=brep)  # -> Faces, Edges, Vertices
index = ClusterInput()
list_item = ListItem(List=deconstruct_brep.Faces, Index=index, Wrap=True)
i = ClusterOutput(list_item)
area = Area(Geometry=list_item)  # -> Area, Centroid
centroid = ClusterOutput(area.Centroid)
