# Grasshopper definition isosurface_light.gh (Grasshopper 1.0.7)
# plug-ins: Millipede, Weaverbird, Pufferfish

# ----
# Define a field around the points
field = Slider(0.14, range=0..1)
negative = Negative(Value=field)
point = Point()
data = Data([field, negative])
list_length = ListLength(List=point)
repeat_data = RepeatData(Data=data, Length=list_length)
point_charge = PointCharge(Point=point, Charge=repeat_data, Decay=2)
merge_fields = MergeFields(Fields=point_charge)

iso_value = Slider(0.003405, range=0..0.01)

# ----
# Create box around GOL iterations
point_2 = Point(Point(0, 0, 0))
deconstruct = Deconstruct(Point=point_2)  # -> XComponent, YComponent, ZComponent
relay = Relay()
subtraction = Subtraction(A=deconstruct.ZComponent)
construct_point = ConstructPoint(XCoordinate=deconstruct.XComponent, YCoordinate=deconstruct.YComponent, ZCoordinate=subtraction)
expression = Expression(Expression="x+2")
relay_2 = Relay()
multiplication = Multiplication(A=relay_2, B=expression)

x_minus_one = XMinusOne(NumberX=relay)

multiplication_2 = Multiplication(A=relay_2, B=x_minus_one)
domain_box = DomainBox(Base=construct_point, X=multiplication_2, Y=multiplication_2, Z=multiplication)

# ----
# Surface resolution
resolution = Slider(34, range=1..50)
range = Range(Domain=Domain(0, 1), Steps=expr("x-1", resolution))
cross_reference = CrossReference(ListListA=range, ListListB=range, ListA=range, CrossMode=1)  # -> ListListA, ListListB, ListA
evaluate_box = EvaluateBox(
    Box=domain_box,
    UParameter=cross_reference.ListListA,
    VParameter=cross_reference.ListListB,
    WParameter=cross_reference.ListA)  # -> Plane, Point, Include

evaluate_field = EvaluateField(Field=merge_fields, Point=evaluate_box.Point)  # -> Tensor, Strength
iso_surface = IsoSurface(
    Box=domain_box,
    Values=evaluate_field.Strength,
    XResolution=resolution,
    YResolution=resolution,
    ZResolution=resolution,
    IsoValue=iso_value,
    MergeVertices=True)
mesh = Mesh(iso_surface)
weaverbird_s_catmull_clark_subdivision = WeaverbirdsCatmullClarkSubdivision(MeshCurves=mesh, Level=2, SmoothNakedEdges=1)
custom_preview = CustomPreview(
    Geometry=weaverbird_s_catmull_clark_subdivision,
    Material={diffuse=RGB(221, 160, 221), emission=RGB(66, 48, 66), shine=0.5, specular=RGB(255, 255, 255), transparency=0})
