# Grasshopper definition isosurface_millipede.gh (Grasshopper 1.0.7)
# plug-ins: Millipede, Weaverbird

# ----
# Box
# A box is defined using domain box component with changable size
# this will be the region that the isosurface is constructed in later on
# after the box definition a set of points is defined
# which the isosurface surrounds
number_slider = Slider(43, range=0..100)
# PARAMETRIC HOUSE
number_slider_2 = Slider(116, range=0..1000)
domain_box = DomainBox(Base=PlaneXY(0, 0, 0), X=number_slider_2, Y=Slider(148, range=0..1000), Z=Slider(172, range=0..1000))
populate_3d = Populate3D(Region=domain_box, Count=number_slider, Seed=Slider(260, range=0..1000))
# Defining a value
# First the domain box needs to be evaluated
# and a set of points which the isosurface mesh
# will be constructed through needs to be extracted
# after that a field needs to be evaluated around the points in the box so
# the isosurface wont be constructed
# around those points
# the strenght of fields defines the boundry around
# the box points which after that the isosurface mesh is being contructed
point = Point(populate_3d)

# ----
# A range with a changable step value to define a
# list of domain which because it has no input
# on domain its by default [0,1]
# the expression on steps input in range component
# is beacuse the x,y,z resolution input in isosurface
# which the higher the number means the more
# verticles and polygons the mesh has thus makingit smoother
# component needs to be one more than the steps
# on range to produce a smooth mesh
range = Slider(30, range=0..50)
# Field definition
range_2 = Range(Domain=Domain(0, 1), Steps=expr("x-1", range))

# ----
# The number of points which was used in populate 3d
# is used to repeate a data of 1.0 and -1.0 which
# is the charge of the fields that are created
# it needs to be the exact number of points and
# that is why is repeated as many times
# the repeated data should always range from
# a minus number to its positive variant
# in this case the best result and the one that has
# been looked for is archieved by this range
panel = Panel("""1.0
-1.0""")
repeat_data = RepeatData(Data=panel, Length=number_slider)
panel_2 = Panel(repeat_data)

# ----
# The points are outputs from populate 3d and
# in order to implement the fields to (around) each
# point a merge component has been used
point_charge = PointCharge(Point=point, Charge=panel_2, Decay=2)
merge_fields = MergeFields(Fields=point_charge)

# ----
# Box evaluation
# The range output is cross refrenced to produce
# three sets of list so box evaluation is possible
# *the box is the domain box
cross_reference = CrossReference(ListListA=range_2, ListListB=range_2, ListA=range_2, CrossMode=1)  # -> ListListA, ListListB, ListA
evaluate_box = EvaluateBox(
    Box=domain_box,
    UParameter=cross_reference.ListListA,
    VParameter=cross_reference.ListListB,
    WParameter=cross_reference.ListA)  # -> Plane, Point, Include

# ----
# A field then is evaluated after these steps to
# define the value required to create the isosurface
# by the rules is set so it results in what is needed
# which is a space around each point
# evaluation allows data to be recognized as numbers
evaluate_field = EvaluateField(Field=merge_fields, Point=evaluate_box.Point)  # -> Tensor, Strength

# ----
# Millipede isosurface
# To create the isosurface mesh the isosurface component
# from millipede plug-in is used
# iso value defines the effective field around each point
# and merge verticles is set to true to produce
# smoother mesh around some corners
isovalue_form_field_evaluation_average = Slider(0.00241, range=0..0.01)
iso_surface = IsoSurface(
    Box=domain_box,
    Values=evaluate_field.Strength,
    XResolution=range,
    YResolution=range,
    ZResolution=range,
    IsoValue=isovalue_form_field_evaluation_average,
    MergeVertices=Toggle(True))

# ----
# Isovalue needs to be as near as possible to the
# average of field evaluation.
# at the exact average it produces unconnected
# isosurface and the changable number allows
# for different results
average = Average(Input=evaluate_field.Strength)
panel_3 = Panel(average)

# ----
# Iso Mesh
mesh = Mesh(iso_surface)

# ----
# Mesh smoothness and thickness
# Smooth Mesh
# You can Increase
# The Iteration or the
# Level for a
# Smoother Result
smooth_mesh = SmoothMesh(Mesh=mesh, Strength=Slider(1, range=0..1), SkipNaked=True, Iterations=Slider(10, range=0..10))
weaverbird_s_loop_subdivision = WeaverbirdsLoopSubdivision(MeshCurves=smooth_mesh, Level=Slider(1, range=1..3), SmoothNakedEdges=1)
# Weaverbird Mesh
# Thicken to give you
# final Thickness
weaverbird_s_mesh_thicken = WeaverbirdsMeshThicken(MeshCurves=weaverbird_s_loop_subdivision, Distance=Slider(2.7, range=0..10), OffsetType=0)
custom_preview = CustomPreview(Geometry=weaverbird_s_mesh_thicken, Material=ColourSwatch(SwatchColor=RGB(61, 118, 153)))
